# Grasshopper definition imageToCircles.ghx (Grasshopper 0.9.76)
# plug-ins: Python Interpreter

abstand_zwischen_kreismittelpunkte_in_mm = Slider(5, range=1..100)
vertikale_untereilungen_des_bildes = Slider(160, range=1..1000)
maximale_kreisgrösse_in_mm = Slider(2.9, range=1..100)
minimale_kreisgrösse_in_mm = Slider(0.5, range=0..100)
bild_speicherort = FilePath("\\bfhfilerbe01.bfh.ch\sches13\Desktop\imageToCircle\171119 Fabu Rebbe Mattis.jpg")
panel = Panel(bild_speicherort)
helligkeitsfaktor = Slider(1, range=1..100)
python = PythonScript(
    imagePath=bild_speicherort,
    gridGapSize=abstand_zwischen_kreismittelpunkte_in_mm,
    gridColumns=vertikale_untereilungen_des_bildes,
    minCircleSize=minimale_kreisgrösse_in_mm,
    maxCircleSize=maximale_kreisgrösse_in_mm,
    brightnessFactor=helligkeitsfaktor)  # -> out, a; inputs gridColumns: Int32
# ---------- python: Python ----------
import System
import rhinoscriptsyntax as rs

if imagePath:
    image = System.Drawing.Bitmap.FromFile(imagePath)
    image.RotateFlip(System.Drawing.RotateFlipType.RotateNoneFlipY)
    
    gridScale = image.Width / gridColumns

    outputX = 0
    outputY = 0
    imageX = 0
    imageY = 0
    
    circleList = []
    
    rs.EnableRedraw(False)
    for imageX in range (0, image.Width, int(gridScale)):
        outputX = outputX+gridGapSize
        outputY = 0

        for imageY in range (0, image.Height, int(gridScale)):
            outputY = outputY + gridGapSize
            pixel = image.GetPixel(imageX, imageY)
            diameter = (pixel.GetBrightness()* gridGapSize)* brightnessFactor

            if (diameter > minCircleSize):
                if (diameter > maxCircleSize):
                    circleList.append(rs.AddCircle((outputX, outputY, 0), (maxCircleSize/2)))
                else:
                    circleList.append(rs.AddCircle((outputX, outputY, 0), (diameter/2)))
    rs.EnableRedraw(True)
    
    if (circleList != 0):
        print ('Erfolgreich Bild konvertiert!')
    else:
        print ('Mit diesen Einstellung bekommt man keinen Kreis ...')
    a = circleList
    
else:
    a = "Please define a image file path"
# ---------- end python ----------
panel_2 = Panel(python.out)
preview = CustomPreview(
    Geometry=python.a,
    Shader={ambient=RGB(0, 0, 0), diffuse=RGB(255, 105, 180), emission=RGB(76, 32, 54), shine=0.5, specular=RGB(255, 255, 255), transparency=0})
